# Grasshopper definition growing town.gh (Grasshopper 1.0.7)
# plug-ins: Monoceros, Bifocals

geo = Geometry([<brep referenced from the Rhino model> x26])
geo_2 = Geometry([<brep referenced from the Rhino model> x26])
geo_3 = Geometry([<brep referenced from the Rhino model> x26])
geo_4 = Geometry([<brep referenced from the Rhino model> x26])
mesh = Mesh(geo)
mesh_2 = Mesh(geo_2)
mesh_3 = Mesh(geo_3)
mesh_4 = Mesh(geo_4)

geo_5 = Geometry([<brep referenced from the Rhino model> x27])
geo_6 = Geometry([<brep referenced from the Rhino model> x27])
geo_7 = Geometry([<brep referenced from the Rhino model> x27])
geo_8 = Geometry([<brep referenced from the Rhino model> x27])
mesh_5 = Mesh(geo_5)
mesh_6 = Mesh(geo_6)
mesh_7 = Mesh(geo_7)
mesh_8 = Mesh(geo_8)

geo_9 = Geometry(<brep referenced from the Rhino model>)
geo_10 = Geometry(<brep referenced from the Rhino model>)
geo_11 = Geometry([<brep referenced from the Rhino model> x2])
geo_12 = Geometry([<brep referenced from the Rhino model> x11])
geo_13 = Geometry([<brep referenced from the Rhino model> x11])
mesh_9 = Mesh(geo_9)
mesh_10 = Mesh(geo_10)
mesh_11 = Mesh(geo_11)
mesh_12 = Mesh(geo_12)
mesh_13 = Mesh(geo_13)

number_slider = Slider(0, range=0..100)
number_slider_2 = Slider(2, range=0..10)
neg = Negative(Value=Slider(8, range=0..10))
pt = ConstructPoint(XCoordinate=number_slider, YCoordinate=neg, ZCoordinate=number_slider)
Y = UnitY(Factor=number_slider_2)
X = UnitX(Factor=number_slider_2)
arrlinear = LinearArray(Geometry=pt, Direction=X, Count=Slider(4, range=0..10))  # -> Geometry, Transform
arrlinear_2 = LinearArray(Geometry=arrlinear.Geometry, Direction=Y, Count=Slider(4, range=0..10))  # -> flatten(Geometry), Transform
series = Series(Start=0, Step=1, Count=Slider(13, range=0..100))
number_slider_3 = Slider(0.5, range=0..1)
item = ListItem(List=arrlinear_2.Geometry, Index=series, Wrap=True)
graft = GraftTree(Tree=item, IncludeEmptyLists=True, IncludeNullItems=True)
box = CenterBox(Base=item, X=number_slider_3, Y=number_slider_3, Z=number_slider_3)
debrep = DeconstructBrep(Brep=box)  # -> Faces, Edges, Vertices
area = Area(Geometry=debrep.Faces)  # -> Area, Centroid

entwine = Entwine(
    Branch00=mesh,
    Branch01=mesh_2,
    Branch02=mesh_3,
    Branch03=mesh_4,
    Branch04=mesh_5,
    Branch05=mesh_6,
    Branch06=mesh_7,
    Branch07=mesh_8,
    Branch08=mesh_10,
    Branch09=mesh_11,
    Branch010=mesh_12,
    Branch011=mesh_13,
    Branch012=mesh_9,
    FlattenInputs=True)

geo_14 = Geometry(entwine)
tstat = TreeStatistics(Tree=geo_14)  # -> Paths, Length, Count
lng = ListLength(List=tstat.Paths)
series_2 = Series(Start=0, Step=1, Count=lng)
concat = Concatenate(FragmentA="module", FragmentB=series_2)  # -> graft(Result)
constmodule = ConstructModule(
    ModuleName=concat,
    ModulePartPoints=graft,
    Geometry=geo_14,
    BasePlane=PlaneXY(0, 0, 0),
    ModulePartDiagonal=Vector(1, 1, 1))

number_slider_4 = Slider(20, range=1..40)
pt_2 = ConstructPoint(XCoordinate=0, YCoordinate=0, ZCoordinate=0)
sqgrid = Square(Plane=pt_2, Size=1, ExtentX=number_slider_4, ExtentY=number_slider_4)  # -> Cells, Points
pt_3 = Point(sqgrid.Points)
pt_4 = ConstructPoint(XCoordinate=expr("x/2", number_slider_4), YCoordinate=expr("x/2", number_slider_4), ZCoordinate=0)
division = Division(A=number_slider_4, B="2")
cir = Circle(Plane=pt_4, Radius=division)
scale = Scale(Geometry=cir, Center=pt_4, Factor=Slider(0.6, range=0..1))  # -> Geometry, Transform

moduleempty = ConstructEmptyModule(BasePlane=PlaneXY(0, 0, 0), ModulePartDiagonal=Vector(1, 1, 1))  # -> Module, Rules
merge = Merge(Data1=moduleempty.Module, Data2=constmodule)
flatten = FlattenTree(Tree=merge, Path="{0}")

incurve = PointInCurve(Point=pt_3, Curve=scale.Geometry)  # -> Relationship, Point
incurve_2 = PointInCurve(Point=pt_3, Curve=cir)  # -> Relationship, Point
int = Integer("2")
int_2 = Integer("2")
mindex = MemberIndex(Set=incurve.Relationship, Member=int)  # -> Index, Count
mindex_2 = MemberIndex(Set=incurve_2.Relationship, Member=int_2)  # -> Index, Count
item_2 = ListItem(List=incurve.Point, Index=mindex.Index, Wrap=True)  # -> flatten(Item)
item_3 = ListItem(List=incurve_2.Point, Index=mindex_2.Index, Wrap=True)  # -> flatten(Item)
mindex_3 = MemberIndex(Set=item_3, Member=item_2)  # -> flatten(Index), Count
cull_i = CullIndex(List=item_3, Indices=mindex_3.Index, Wrap=True)

data = Data(flatten)

panel = Panel("""10
12
13""")
item_4 = ListItem(List=data, Index=panel, Wrap=True)
rulebound = ConstructRuleAtBoundary(Module=flatten(item_4), ConnectorIndex="5")

item_5 = ListItem(List=data, Index="0", Wrap=True)
rulebound_2 = ConstructRuleAtBoundary(Module=flatten(item_5), ConnectorIndex="5")

pt_5 = Point([<point referenced from the Rhino model> x7])
ruletyppt = TypedRuleFromPoint(Modules=data, PointTag=pt_5, ConnectorType="Z-dir-stair")

pt_6 = Point([<point referenced from the Rhino model> x7])
ruletyppt_2 = TypedRuleFromPoint(Modules=data, PointTag=pt_6, ConnectorType="Z-coloumn")

merge_2 = Merge(Data1=rulebound, Data2=ruletyppt_2, Data3=ruletyppt)  # -> flatten(Result)
ruleindiffunused = IndifferentRulesForUnusedConnectors(Module=flatten, Rules=merge_2)
merge_3 = Merge(Data1=flatten(ruleindiffunused), Data2=merge_2)
collectrules = CollectRules(Modules=flatten, RulesAllowed=merge_3, ExplicitRulesDisallowed=rulebound_2)

Z = UnitZ(Factor=1)
arrlinear_3 = LinearArray(Geometry=cull_i, Direction=Z, Count=Slider(4, range=0..10))  # -> Geometry, Transform
slotall = ConstructSlotWithAllModulesAllowed(SlotPoint=arrlinear_3.Geometry, BasePlane=PlaneXY(0, 0, 0), GridSlotDiagonal=Vector(1, 1, 1))

wfc = MonocerosWFCSolver(
    Slots=flatten(slotall),
    Modules=flatten(flatten),
    Rules=flatten(collectrules),
    RandomSeed=Slider(18, range=0..100),
    MaxAttempts=10,
    MaxObservations=2147483647,
    MaxTime=0,
    UseShannonEntropy=False)  # -> Out, Slots, Deterministic, Contradictory, Seed, Attempts, Observations
materialize = MaterializeSlots(Modules=flatten, Slots=wfc.Slots)  # -> Geometry, Transform
preview = CustomPreview(Geometry=materialize.Geometry, Material=ColourSwatch(SwatchColor=RGB(235, 235, 235)))
